# Grasshopper definition Bridge_v01.gh (Grasshopper 1.0.7)

# BM  //  COMPLEX FORMING
# 19 Nov - Meshes
inputs = Data("INPUTS")
process = Data("PROCESS")
number_slider = Slider(236, range=0..1000)
outputs = Data("OUTPUTS")
unit_z = UnitZ(Factor=Slider(169, range=0..1000))
rectangle = Rectangle(Plane=PlaneXY(0, 0, 0), XSize=number_slider, YSize=number_slider, Radius=0)  # -> Rectangle, Length
unit_x = UnitX(Factor=Slider(279, range=0..1000))
unit_x_2 = UnitX(Factor=Slider(344, range=0..1000))
unit_x_3 = UnitX(Factor=Slider(568, range=0..1000))
boundary_surfaces = BoundarySurfaces(Edges=rectangle.Rectangle)
subd_from_mesh = SubDFromMesh(Mesh=boundary_surfaces, Creases=1, Corners=1, Interpolate=False)
extrude = Extrude(Base=boundary_surfaces, Direction=unit_z)
negative = Negative(Value=unit_x_2)
move = Move(Geometry=subd_from_mesh, Motion=unit_x)  # -> Geometry, Transform
move_2 = Move(Geometry=rectangle.Rectangle, Motion=negative)  # -> Geometry, Transform
move_3 = Move(Geometry=extrude, Motion=unit_x_3)  # -> Geometry, Transform

# ---- group: RH_OUT:crv
# VERSION 01  //  2021.11.19
curve = Curve(move_2.Geometry)

# ---- group: RH_OUT:brep
brep = Brep(move_3.Geometry)

# ---- group: RH_OUT:srf
surface = Surface(boundary_surfaces)

# ---- group: RH_OUT:subd
subd = SubD(move.Geometry)
