# Grasshopper definition Solihiya00_v3a.gh (Grasshopper 1.0.7)
# plug-ins: Weaverbird

trees_scale = Slider(1, range=0.01..5)
boundary_points = Point([Point(3.276063232, 11.22393265, 0), Point(-8.663308309, 18.34793677, 0), Point(1.933445945, 29.8182527, 0), Point(4.563590556, 44.35352998, 0), Point(16.82526635, 45.56634711, 0), Point(21.02790203, 38.13233168, 0), Point(28.59645688, 28.18032252, 0), Point(37.25900897, 35.35760854, 0), Point(44.20839072, 30.49399766, 0), Point(45.48306076, 18.29184062, 0), Point(41.16014718, 7.166574688, 0), Point(31.9185288, 7.766826542, 0), Point(24.13211838, 6.224272936, 0), Point(21.34411088, 9.850298757, 0), Point(18.25341983, 16.52861301, 0)])

zheight = GetNumber(Slider(180, range=1..400), AtLeast=1, AtMost=1, Maximum=400, Minimum=1)
solangle = GetNumber(Slider(25, range=1..179), AtLeast=1, AtMost=1, Maximum=179, Minimum=1)
tod = GetNumber(Slider(6, range=1..9), AtLeast=1, AtMost=1, Maximum=9, Minimum=1)
smlopening = GetNumber(Slider(0, range=0..40), AtLeast=1, AtMost=1, Maximum=45, Minimum=0)
lrgopening = GetNumber(Slider(45, range=0..45), AtLeast=1, AtMost=1, Maximum=45, Minimum=0)
show_trees = GetBoolean(Toggle(True), AtLeast=1, AtMost=1, FalseValue="False", TrueValue="True")
trees_no = GetNumber(Slider(50, range=0..200), AtLeast=1, AtMost=1, Maximum=200, Minimum=1)
trees_location = GetNumber(Slider(20, range=1..50), AtLeast=1, AtMost=1, Maximum=50, Minimum=1)
trees_scale_2 = GetNumber(trees_scale, AtLeast=1, AtMost=1, Maximum=2.01, Minimum=0.01)
show_people = GetBoolean(Toggle(True), AtLeast=1, AtMost=1, FalseValue="False", TrueValue="True")
people_location = GetNumber(Slider(40, range=1..50), AtLeast=1, AtMost=1, Maximum=50, Minimum=1)
show_annotations = GetBoolean(Toggle(True), AtLeast=1, AtMost=1, FalseValue="False", TrueValue="True")
population = GetNumber(Slider(15, range=0..50), AtLeast=1, AtMost=1, Maximum=50, Minimum=1)
points = GetPoint(boundary_points, AtLeast=1, AtMost=2147483647, Realtime=True)

show_annotations_2 = GetBoolean(Toggle(True), AtLeast=1, AtMost=1, FalseValue="False", TrueValue="True")
pline = PolyLine(Vertices=points, Closed=True)

offset = OffsetCurve(Curve=pline, Distance=expr("x*-1", Slider(1, range=0..10)), Corners=1)
explode = Explode(Curve=offset, Recursive=True)  # -> Segments, Vertices
lng = ListLength(List=explode.Segments)
multiplication = Multiplication(A=lng, B=Slider(2, range=1..3))
reb = RebuildCurve(Curve=offset, Count=multiplication, Tangents=False)

# ---- group: Kangaroo
cluster = Cluster_6(E=pline, C=pline, strength=expr("x/1000", zheight))

# ---- group: Trees
mesh = Mesh(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)

# ----
bang = ExplodeTree(Data=cluster)
item = ListItem(List=bang, Index=0, Wrap=True)
offset_2 = OffsetCurve(Curve=pline, Distance=expr("x*-1", Slider(1, range=0..10)), Corners=1)
facen = FaceNormals(Mesh=item)  # -> Centers, Normals

# ---- group: Human
mesh_2 = Mesh(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)

# ----
Z = UnitZ(Factor="0.05")
move = Move(Geometry=offset_2, Motion=Z)  # -> Geometry, Transform
boundary = BoundarySurfaces(Edges=move.Geometry)
mesh_3 = Mesh(boundary)
demesh = DeconstructMesh(Mesh=mesh_3)  # -> Vertices, Faces, Colours, Normals
conmesh = ConstructMesh(Vertices=demesh.Vertices, Faces=demesh.Faces, Colours=ColourSwatch(SwatchColor=RGB(105, 105, 105)))
m_catmull_clark = WeightedCatmullClarkSubdivision(M=conmesh, L=Slider(1, range=0..10), E=Slider(1, range=0..10), DF=0, TE=1, TV=1)  # -> out, A; inputs M: Mesh, DF: list, TE: list, TV: list; same code as m_catmull_clark
mblur = BlurMesh(Mesh=m_catmull_clark.A, Iterations=Slider(1, range=0..5))

clean = CleanTree(RemoveNulls=True, RemoveInvalid=True, RemoveEmpty=True, Tree=cluster)
bang_2 = ExplodeTree(Data=clean)  # -> Branch0, Branch1
item_2 = ListItem(List=bang_2.Branch0, Index=0, Wrap=True)
mesh_4 = Mesh(item_2)
area = Area(Geometry=mesh_4)  # -> Area, Centroid

area_2 = Area(Geometry=mblur)  # -> Area, Centroid

# ---- group: RH_OUT:meshArea
data = Data(area.Area)

# ---- group: RH_OUT:plotArea
data_2 = Data(area_2.Area)

# ---- group: RH_OUT: Platform
rh_out_mesh = Mesh(mblur)

# ---- group: RH_OUT:zHeight
data_3 = Data(zheight)

# ---- group: RH_OUT:solAngle
data_4 = Data(solangle)

# ---- group: RH_OUT:toD
data_5 = Data(tod)

# ---- group: RH_OUT:smlOpening
data_6 = Data(smlopening)

# ---- group: RH_OUT:lrgOpening
data_7 = Data(lrgopening)

# ---- group: RH_OUT:treesNo
data_8 = Data(trees_no)

# ---- group: RH_OUT:treesLocation
data_9 = Data(trees_location)

# ---- group: RH_OUT:treesScale
data_10 = Data(trees_scale_2)

# ---- group: RH_OUT:population
data_11 = Data(population)

# ---- group: RH_OUT:peopleLocation
data_12 = Data(people_location)

# ----
panel = Panel(data)
panel_2 = Panel(data_2)
disc = Discontinuity(Curve=pline, Level=1)  # -> Points, Parameters
lng_2 = ListLength(List=disc.Points)
division = Division(A=lng_2, B="3")
series = Series(Start=Slider(2, range=0..10), Step=Slider(3, range=0..10), Count=division)
item_3 = ListItem(List=disc.Points, Index=series, Wrap=True)
item_4 = ListItem(List=item_3, Index=Slider(2, range=0..10), Wrap=True)
pt = Point(item_4)
move_2 = Move(Geometry=pt, Motion="{3,12,0}")  # -> Geometry, Transform
item_5 = ListItem(List=disc.Points, Index="1", Wrap=True)
line = LineSDL(Start=item_5, Direction=Vector(0, 0, 1), Length=Slider(13, range=1..20))
end = EndPoints(Curve=line)  # -> Start, End
round = Round(Number=data_2)  # -> Nearest, Floor, Ceiling
rad = Radians(Degrees=Slider(15, range=0..100))
line_2 = LineSDL(Start=move_2.Geometry, Direction=Vector(0, 0, 1), Length=Slider(13, range=1..20))
rot3d = Rotate3D(Geometry=line, Angle=expr("x*-1", rad), Center=end.Start, Axis="{0,1,0}")  # -> Geometry, Transform
rad_2 = Radians(Degrees=Slider(15, range=0..100))
end_2 = EndPoints(Curve=line_2)  # -> Start, End
concat = Concatenate(FragmentC="Plot Area", FragmentA=round.Nearest, FragmentB="m²")
end_3 = EndPoints(Curve=rot3d.Geometry)  # -> Start, End
rad_3 = Radians(Degrees=Slider(90, range=0..180))
rad_4 = Radians(Degrees=Slider(15, range=0..100))
c_script = CSharpScript(face="Arial", bold=Toggle(False), content=concat, pl=area_2.Centroid)  # -> out, A; inputs face: String, bold: Boolean, italics: Boolean, size: Double, content: String, pl: Plane
# ---------- c_script: C# usings ----------
using System.IO;
using System.Linq;
using System.Data;
using System.Drawing;
using System.Reflection;
using System.Windows.Forms;
using System.Xml;
using System.Xml.Linq;
using System.Runtime.InteropServices;

using Rhino.DocObjects;
using Rhino.Collections;
using GH_IO;
using GH_IO.Serialization;
# ---------- c_script: C# ----------
    if(size == 0)
      size = 1;

    if(!string.IsNullOrEmpty(face) && size > 0 && !string.IsNullOrEmpty(content) &&
      pl.IsValid)
    {
      using (var doc = Rhino.RhinoDoc.CreateHeadless(null))
      {
        var te = doc.Objects.AddText(content, pl, size, face, bold, italics);
        var txt = doc.Objects.Find(te) as Rhino.DocObjects.TextObject;

        if(txt != null)
        {
          var tt = txt.Geometry as Rhino.Geometry.TextEntity;
          A = tt.Explode();
        }
      }
    }
# ---------- end c_script ----------
neg = Negative(Value=rad_3)
rot3d_2 = Rotate3D(Geometry=line_2, Angle=rad_4, Center=end_2.Start, Axis="{0,1,0}")  # -> Geometry, Transform
line_3 = LineSDL(Start=end_3.End, Direction="{1,0,0}", Length=Slider(-5, range=-20..20))
cluster_2 = Cluster_9(curve=flatten(c_script.A))
end_4 = EndPoints(Curve=rot3d_2.Geometry)  # -> Start, End
end_5 = EndPoints(Curve=line_3)  # -> Start, End
concat_2 = Concatenate(
    FragmentC="Sol Altitude = ",
    FragmentA=data_4,
    FragmentB="°",
    FragmentD="Time of Day = ",
    FragmentE=data_5,
    FragmentF=" sol hrs")
round_2 = Round(Number=data)  # -> Nearest, Floor, Ceiling
xz = XZPlane(Origin=end_5.End)
line_4 = LineSDL(Start=end_4.End, Direction="{1,0,0}", Length=Slider(3, range=-20..20))
panel_3 = Panel("""Mesh Surface
Area""")
move_3 = Move(Geometry=xz, Motion="{0,0,2.2}")  # -> Geometry, Transform
end_6 = EndPoints(Curve=line_4)  # -> Start, End
panel_4 = Panel("""Mountain
Area""")
dash_pattern = DashPattern(Curve=[rot3d.Geometry, line_3], Pattern=[Slider(0, range=0..1), Slider(0.5, range=0..1), Slider(0.2, range=0..1)])  # -> flatten(Dashes), Gaps
concat_3 = Concatenate(FragmentC=panel_3, FragmentA=round_2.Nearest, FragmentB="m²")
xz_2 = XZPlane(Origin=end_6.End)
c_script_2 = CSharpScript(face="Arial", bold=Toggle(False), size=Slider(0.75, range=0..3), content=concat_3, pl=move_3.Geometry)  # -> out, A; inputs face: String, bold: Boolean, italics: Boolean, size: Double, content: String, pl: Plane; same code as c_script
panel_5 = Panel("""Mountain
Area""")
move_4 = Move(Geometry=xz_2, Motion="{0,0,2.2}")  # -> Geometry, Transform
cluster_3 = Cluster_9(curve=flatten(c_script_2.A))

bbox = BoundingBox(Content=pline, Plane=PlaneXY(0, 0, 0))  # -> Box, Box_2
debrep = DeconstructBrep(Brep=bbox.Box)  # -> Faces, Edges, Vertices
xy = XYPlane(Origin=Point(0, 0, 0))
area_3 = Area(Geometry=debrep.Faces)  # -> Area, Centroid
sqrt = SquareRoot(Value=area_3.Area)
circle = CircleCNR(Center=area_3.Centroid, Normal=xy, Radius=sqrt)
boundary_2 = BoundarySurfaces(Edges=circle)
rad_5 = Radians(Degrees=solangle)
sph = Sphere(Base=area_3.Centroid, Radius=sqrt)
divide = DivideCurve(Curve=circle, Count="2", Kinks=False)  # -> Points, Tangents, Parameters
item_6 = ListItem(List=divide.Points, Index=0, Wrap=True)  # -> Item, Item1
geodesic = Geodesic(Surface=sph, Start=item_6.Item, End=item_6.Item1)
ln = Line(StartPoint=item_6.Item, EndPoint=item_6.Item1)

# ---- group: Get Land for Trees
crv = Curve(circle)
medges = MeshEdges(Mesh=crv)  # -> flatten(NakedEdges), InteriorEdges, NonManifoldEdges
join = JoinCurves(Curves=medges.NakedEdges, Preserve=False)
offset_3 = OffsetCurve(Curve=pline, Distance=Slider(7, range=0..10), Corners=1)
debrep_2 = DeconstructBrep(Brep=join)  # -> Faces, Edges, Vertices
boundary_3 = BoundarySurfaces(Edges=join)
pdecon = Deconstruct(Point=debrep_2.Vertices)  # -> XComponent, YComponent, ZComponent
Z_2 = UnitZ(Factor=pdecon.ZComponent)
move_5 = Move(Geometry=offset_3, Motion=Z_2)  # -> Geometry, Transform
join_2 = JoinCurves(Curves=move_5.Geometry, Preserve=False)  # -> flatten(Curves)
rdiff = RegionDifference(CurvesA=boundary_3, CurvesB=join_2)
boundary_4 = BoundarySurfaces(Edges=rdiff)

# ----
neg_2 = Negative(Value=rad_5)

rot3d_3 = Rotate3D(Geometry=geodesic, Angle=neg_2, Center=area_3.Centroid, Axis=ln)  # -> Geometry, Transform
divide_2 = DivideCurve(Curve=rot3d_3.Geometry, Count=10, Kinks=False)  # -> Points, Tangents, Parameters
item_7 = ListItem(List=divide_2.Points, Index=tod, Wrap=True)

# ---- group: Get Curves for Mountain
cluster_4 = Cluster_3(d1=join, d2=offset_3, G=boundary_4, C=offset_3, C_2=join)

# ----
pt_2 = Point(item_7)
dist = Distance(PointA=facen.Centers, PointB=pt_2)
remap = Remap(data=dist, min=smlopening, max=lrgopening)
wbframe = WeaverbirdsPictureFrame(MeshPolylines=item, Distance=remap, InsetType=0)
wbcatmullclark = WeaverbirdsCatmullClarkSubdivision(MeshCurves=wbframe, Level=1, SmoothNakedEdges=1)
msphere = MeshSphere(Base=item_7, Radius=Slider(2, range=0..10), UCount=10, VCount=20)
medges_2 = MeshEdges(Mesh=wbcatmullclark)  # -> NakedEdges, InteriorEdges, NonManifoldEdges
medges_3 = MeshEdges(Mesh=msphere)  # -> NakedEdges, InteriorEdges, NonManifoldEdges
data_13 = Data(flatten([medges_2.InteriorEdges, medges_2.NakedEdges]))
data_14 = Data(flatten(medges_3.InteriorEdges))
curvepoint = PointOnCurve(data_13, parameter=0.5)
curvepoint_2 = PointOnCurve(data_14, parameter=0.5)
pt_3 = Point(item_7)
pt_4 = Point(area_3.Centroid)
pull = PullPoint(Point=curvepoint, Geometry=pt_3, ClosestOnly=True)  # -> ClosestPoint, Distance
pull_2 = PullPoint(Point=curvepoint_2, Geometry=pt_4, ClosestOnly=True)  # -> ClosestPoint, Distance
bnd = Bounds(Numbers=pull.Distance)
demesh_2 = DeconstructMesh(Mesh=msphere)  # -> Vertices, Faces, Colours, Normals
bnd_2 = Bounds(Numbers=pull_2.Distance)
remap_2 = RemapNumbers(Value=pull.Distance, Source=bnd, Target=Domain(0, 1))  # -> flatten(Mapped), Clipped
remap_3 = RemapNumbers(Value=pull_2.Distance, Source=bnd_2, Target=Domain(0, 1))  # -> flatten(Mapped), Clipped
gradient = Gradient(
    LowerLimit=0,
    UpperLimit=1,
    Parameter=remap_3.Mapped,
    stops=[0: RGB(255, 255, 0), 0: RGB(255, 255, 0), 1: RGB(255, 153, 0)])
gradient_2 = Gradient(
    LowerLimit=0,
    UpperLimit=1,
    Parameter=reverse(remap_2.Mapped),
    stops=[0: RGB(0, 34, 255), 0.5: RGB(255, 0, 85), 1: RGB(255, 153, 0)])
conmesh_2 = ConstructMesh(Vertices=demesh_2.Vertices, Faces=demesh_2.Faces, Colours=gradient)
c_script_3 = CSharpScript(crv=data_13, color=gradient_2)  # -> out, A; inputs crv: Curve, color: Color; same code as c_script
area_4 = Area(Geometry=crv)  # -> Area, Centroid
expression = Expression(x=area_4.Area, Expression="2*(sqrt(x/π))")

# ---- group: RH_OUT:Total Land Area
data_15 = Data(area_4.Area)

# ---- group: RH_OUT:landDiameter
data_16 = Data(expression)

# ---- group: RH_OUT: Edges
rh_out_edges = Curve(c_script_3.A)

# ---- group: RH_OUT: Sun Curves
mesh_5 = Mesh(conmesh_2)

# ---- group: RH_OUT: Sol Angle
rh_out_sol_angle = Curve(rot3d_3.Geometry)

# ----
panel_6 = Panel(data_15)
panel_7 = Panel(data_16)
area_5 = Area(Geometry=boundary_2)  # -> Area, Centroid

# ---- group: Sun Vector
ln_2 = Line(StartPoint=item_7, EndPoint=area_5.Centroid)

# ----
curvepoint_3 = PointOnCurve(rot3d_3.Geometry, parameter=0.481)
line_5 = LineSDL(Start=item_7, Direction=ln_2, Length=Slider(4, range=0..100))
end_7 = EndPoints(Curve=line_5)  # -> Start, End
pl_3pt = Plane3Pt(PointA=end_7.End, PointB=end_7.Start, PointC=curvepoint_3)
prot = RotatePlane(Plane=pl_3pt, Angle=neg)
c_script_4 = CSharpScript(face="Arial", bold=Toggle(False), size=Slider(0.635, range=0..3), content=concat_2, pl=prot)  # -> out, A; inputs face: String, bold: Boolean, italics: Boolean, size: Double, content: String, pl: Plane; same code as c_script
round_3 = Round(Number=area_5.Area)  # -> Nearest, Floor, Ceiling
cluster_5 = Cluster_9(curve=flatten(c_script_4.A))
concat_4 = Concatenate(FragmentC=panel_5, FragmentA=round_3.Nearest, FragmentB="m²")
dash_pattern_2 = DashPattern(
    Curve=[rot3d_2.Geometry, line_4, line_5],
    Pattern=[Slider(0, range=0..1), Slider(0.5, range=0..1), Slider(0.2, range=0..1)])  # -> flatten(Dashes), Gaps
c_script_5 = CSharpScript(face="Arial", bold=Toggle(False), size=Slider(0.75, range=0..3), content=concat_4, pl=move_4.Geometry)  # -> out, A; inputs face: String, bold: Boolean, italics: Boolean, size: Double, content: String, pl: Plane; same code as c_script
cluster_6 = Cluster_9(curve=flatten(c_script_5.A))

rdiff_2 = RegionDifference(CurvesA=boundary_2, CurvesB=flatten([cluster_4, reb]))
rdiff_3 = RegionDifference(CurvesA=rdiff, CurvesB=cluster_4)
cluster_7 = Cluster_2(mesh=crv)

# ----
# Populating Trees
cluster_8 = Cluster_8(E=rdiff_3, G_2=show_trees, data=rdiff_3, N=trees_location, C=trees_no, B=trees_scale_2, G=mesh, M=mesh)

# ---- group: Mountain Creation
cluster_9 = Cluster(curve=cluster_4, data=Slider(0, range=0..1), data_2=Slider(2.905, range=0..10))

# ----
# Populating People
cluster_10 = Cluster_4(E=rdiff_2, G=show_people, G_3=mesh_2, N=people_location, C=population, G_2=mesh_2)

# ---- group: Surface Green Variety
cluster_11 = Cluster_5(E=rdiff_2, G=rdiff_2)

# ----
merge = Merge(Data1=cluster_7, Data2=cluster_11)

medges_4 = MeshEdges(Mesh=cluster_11)  # -> NakedEdges, InteriorEdges, NonManifoldEdges; disabled
data_17 = Data(flatten(medges_4.NakedEdges))  # disabled
join_3 = JoinCurves(Curves=data_17, Preserve=False)  # disabled
item_8 = ListItem(List=join_3, Index=0, Wrap=True)  # disabled
curve = Curve(item_8)  # disabled

# ---- group: Shadow Analysis
cluster_12 = Cluster_10(S=wbcatmullclark, G=0, L=ln_2, pt=item_7, M=cluster_11)  # -> data_2, C; disabled

# ----
c_script_6 = CSharpScript(crv=cluster_12.data_2, color=cluster_12.C)  # -> out, A; inputs crv: Curve, color: Color; disabled; same code as c_script

# ---- group: Concrete Ground
cluster_13 = Cluster_11(E=curve, curve=curve)  # disabled

# ----
boundary_5 = BoundarySurfaces(Edges=c_script_6.A)
item_9 = ListItem(List=boundary_5, Index=0, Wrap=True)
area_6 = Area(Geometry=item_9)  # -> flatten(Area), Centroid

# ---- group: RH_OUT:shadowArea
data_18 = Data(area_6.Area)

# ---- group: RH_OUT: Mountain
mesh_6 = Mesh(cluster_9)

# ---- group: RH_OUT: Land
mesh_7 = Mesh(merge)

# ---- group: RH_OUT: Trees
mesh_8 = Mesh(cluster_8)

# ---- group: RH_OUT: People
mesh_9 = Mesh(cluster_10)

# ---- group: RH_OUT:shadowEdges
rh_out_edges_2 = Curve(c_script_6.A)  # disabled

# ----
panel_8 = Panel(data_18)
area_7 = Area(Geometry=cluster_9)  # -> Area, Centroid
line_6 = LineSDL(Start=area_7.Centroid, Direction=Vector(0, 0, 1), Length=Slider(13, range=1..20))
end_8 = EndPoints(Curve=line_6)  # -> Start, End
rot3d_4 = Rotate3D(Geometry=line_6, Angle=rad_2, Center=end_8.Start, Axis="{0,1,0}")  # -> Geometry, Transform
end_9 = EndPoints(Curve=rot3d_4.Geometry)  # -> Start, End
line_7 = LineSDL(Start=end_9.End, Direction="{1,0,0}", Length=Slider(3, range=-20..20))
end_10 = EndPoints(Curve=line_7)  # -> Start, End
round_4 = Round(Number=area_7.Area)  # -> Nearest, Floor, Ceiling
xz_3 = XZPlane(Origin=end_10.End)
move_6 = Move(Geometry=xz_3, Motion="{0,0,2.2}")  # -> Geometry, Transform
dash_pattern_3 = DashPattern(Curve=[rot3d_4.Geometry, line_7], Pattern=[Slider(0, range=0..1), Slider(0.5, range=0..1), Slider(0.2, range=0..1)])  # -> flatten(Dashes), Gaps
concat_5 = Concatenate(FragmentC=panel_4, FragmentA=round_4.Nearest, FragmentB="m²")
c_script_7 = CSharpScript(face="Arial", bold=Toggle(False), size=Slider(0.75, range=0..3), content=concat_5, pl=move_6.Geometry)  # -> out, A; inputs face: String, bold: Boolean, italics: Boolean, size: Double, content: String, pl: Plane; same code as c_script
cluster_14 = Cluster_9(curve=flatten(c_script_7.A))
stream_gate = StreamGate(
    Stream=[cluster_6, cluster_3, cluster_2, cluster_5, dash_pattern_2.Dashes, cluster_14, dash_pattern_3.Dashes, dash_pattern.Dashes],
    Gate=show_annotations)  # -> Target0, Target1

# ---- group: RH_OUT:annot
curve_2 = Curve(flatten(stream_gate.Target1))

# ==== cluster Remap: Remaps numbers
data = ClusterInput()
min = ClusterInput()
max = ClusterInput()
bnd = Bounds(Numbers=data)
dom = ConstructDomain(DomainStart=min, DomainEnd=max)
remap = RemapNumbers(Value=data, Source=bnd, Target=dom)  # -> Mapped, Clipped
R = ClusterOutput(remap.Mapped)

# ==== cluster Cluster
curve = ClusterInput()
curve_2 = Curve(curve)
length = Length(Curve=curve_2)
multiplication = Multiplication(A=length, B=Slider(0.1, range=0..1))
boundary = BoundarySurfaces(Edges=curve_2)
custom_mesh_settings = SettingsCustom(
    StitchSeams=True,
    SimplePlanes=False,
    Refine=True,
    MinCount=16,
    MaxCount=400,
    AspectRatio=20,
    MaxDistance=0,
    MaxAngle=20,
    MinEdge=multiplication,
    MaxEdge=multiplication)
mesh = MeshBrep(Brep=boundary, Settings=custom_mesh_settings)
deconstruct_mesh = DeconstructMesh(Mesh=mesh)  # -> Vertices, Faces, Colours, Normals
mesh_edges = MeshEdges(Mesh=mesh)  # -> simplify(NakedEdges), InteriorEdges, NonManifoldEdges
join_curves = JoinCurves(Curves=mesh_edges.NakedEdges, Preserve=False)  # -> simplify(Curves)
data = ClusterInput()
data_2 = ClusterInput()
pull_point = PullPoint(Point=simplify(deconstruct_mesh.Vertices), Geometry=simplify(graft(join_curves)), ClosestOnly=True)  # -> ClosestPoint, Distance
data_3 = Data(data)
data_4 = Data(data_2)
construct_domain = ConstructDomain(DomainStart=data_3, DomainEnd=data_4)
bounds = Bounds(Numbers=pull_point.Distance)
remap_numbers = RemapNumbers(Value=pull_point.Distance, Source=bounds, Target=construct_domain)  # -> Mapped, Clipped
graph_mapper = GraphMapper(
    remap_numbers.Mapped,
    x0=0,
    x1=5,
    y0=0,
    y1=5,
    amplitude=0.6165744066,
    container_name="Perlin",
    decay=0.6327519417,
    frequency=0.2492231727,
    x_offset=0.5728219748,
    y_offset=0.4342004061)
graph_mapper_2 = GraphMapper(remap_numbers.Mapped, x0=0, x1=5, y0=0, y1=5, container_name="Sine", Equation_px=[0, 1], Equation_py=[0, 1])
unit_z = UnitZ(Factor=graph_mapper)
gradient = Gradient(
    LowerLimit=-0.5,
    UpperLimit=0.5,
    Parameter=graph_mapper_2,
    stops=[0.445: RGB(99, 68, 22), 0.773: RGB(112, 77, 50), 1: RGB(46, 84, 21)])
gradient_2 = Gradient(LowerLimit=-0.5, UpperLimit=0.5, Parameter=graph_mapper, stops=[0.0306: RGB(99, 68, 22), 1: RGB(156, 116, 84)])
move = Move(Geometry=deconstruct_mesh.Vertices, Motion=unit_z)  # -> Geometry, Transform
construct_mesh = ConstructMesh(Vertices=move.Geometry, Faces=deconstruct_mesh.Faces, Colours=gradient)
m_catmull_clark = WeightedCatmullClarkSubdivision(M=construct_mesh, L=Slider(1, range=0..10), E=Slider(1, range=0..10), DF=0, TE=1, TV=1)  # -> out, A; inputs M: Mesh, DF: list, TE: list, TV: list
# ---------- m_catmull_clark: VB ----------
    Component.Params.Input(0).Name = "Mesh"
    Component.Params.Input(0).Description = "An open or closed mesh composed of either triangle or quad based faces"
    Component.Params.Input(1).Name = "Loops"
    Component.Params.Input(1).Description = "The number of iterations applied to each face"
    Component.Params.Input(2).Name = "Edge Type"
    Component.Params.Input(2).Description = "0=Fixed, 1=Smooth, 2=Fixed Corners"
    Component.Params.Input(3).Name = "Face Distance [Vertex]"
    Component.Params.Input(3).Description = "An optional list of double values which overides the distance the new faced based vertex will be offset along the face normal (0=Default)"
    Component.Params.Input(4).Name = "Edge Weight [Vertex]"
    Component.Params.Input(4).Description = "An optional list of double values which overides the percent between the existing edge midpoint and the new smoothed vertex (1=Default)"
    Component.Params.Input(5).Name = "Vertex Weight [Vertex]"
    Component.Params.Input(5).Description = "An optional list of double values which overides the percent between the existing vertex and the new smoothed vertex (1=Default)"

    Component.Params.Output(1).Name = "Mesh"
    Component.Params.Output(1).Description = "If successful, a valid mesh"

    If m IsNot Nothing Then
      Dim ma As New mesh
      Dim i,lp As Integer
      Dim txV,txE,txF As New list(Of Double)
      Dim xV(),xE(),xF() As Double
      Dim bn As Boolean
      Dim cb As Boolean

      'input mesh to the looped mesh
      m.weld(math.pi)
      ma = m

      ' match multiplier and color values to vertex count
      xV = TV.toarray()
      xE = TE.toarray()
      xF = DF.toarray()
      For i = 0 To m.Vertices.count() - 1 Step 1
        txV.add(xV(bC(xV, i)))
        txE.add(xE(bC(xE, i)))
        txF.add(xF(bC(xF, i)))
      Next
      xV = txV.toarray()
      xE = txE.toarray()
      xF = txF.toarray()

      bn = m.IsClosed() = False

      For lp = 0 To L - 1 Step 1

        Dim mv As Rhino.Geometry.Collections.MeshVertexList
        Dim mf As Rhino.Geometry.Collections.MeshFaceList
        Dim mfn As Rhino.Geometry.Collections.MeshFaceNormalList
        Dim mc As Rhino.Geometry.Collections.MeshVertexColorList
        Dim mte As Rhino.Geometry.Collections.MeshTopologyEdgeList
        Dim mtv As Rhino.Geometry.Collections.MeshTopologyVertexList
        Dim mnv() As Boolean
        Dim nes As New list(Of Boolean)

        If ma.VertexColors.Count() > 0 Then
          cb = True
        Else
          cb = False
          ma.VertexColors.CreateMonotoneMesh(color.LightBlue)
        End If

        mv = ma.Vertices
        mf = ma.Faces
        mfn = ma.FaceNormals
        mc = ma.VertexColors
        mte = ma.TopologyEdges
        mtv = ma.TopologyVertices

        mnv = ma.GetNakedEdgePointStatus

        Dim vo As New list(Of point3d)
        Dim fo As New list(Of MeshFace)
        Dim j,k,u,v,cf,ce,cv As Integer
        Dim fi() As Integer
        Dim p(4) As point3d
        Dim mvi(3) As Integer
        Dim nrm As vector3d
        Dim av,ae,af As Double
        Dim rv,re,rf As New list(Of Double)
        Dim tc As color
        Dim oc As New list(Of color)

        cv = mv.count()
        ce = mte.count()
        cf = mf.count()

        'Faces
        For i = 0 To cf - 1 Step 1
          fi = mtv.IndicesFromFace(i)
          mvi(0) = mtv.MeshVertexIndices(fi(0))(0)
          mvi(1) = mtv.MeshVertexIndices(fi(1))(0)
          mvi(2) = mtv.MeshVertexIndices(fi(2))(0)
          If mf(i).IsQuad() Then mvi(3) = mtv.MeshVertexIndices(fi(3))(0)

          If mf(i).IsQuad() Then
            fo.add(New meshface(i, cF + mte.GetEdgeIndex(fi(0), fi(1)), cE + cF + mvi(1), cF + mte.GetEdgeIndex(fi(1), fi(2))))
            fo.add(New meshface(cF + mte.GetEdgeIndex(fi(1), fi(2)), cE + cF + mvi(2), cF + mte.GetEdgeIndex(fi(2), fi(3)), i))
            fo.add(New meshface(cE + cF + mvi(3), cF + mte.GetEdgeIndex(fi(3), fi(0)), i, cF + mte.GetEdgeIndex(fi(2), fi(3))))
            fo.add(New meshface(cF + mte.GetEdgeIndex(fi(0), fi(1)), i, cF + mte.GetEdgeIndex(fi(3), fi(0)), cE + cF + mvi(0)))
            av = (xV(mvi(0)) + xV(mvi(1)) + xV(mvi(2)) + xV(mvi(3))) / 4
            ae = (xE(mvi(0)) + xE(mvi(1)) + xE(mvi(2)) + xE(mvi(3))) / 4
            af = (xF(mvi(0)) + xF(mvi(1)) + xF(mvi(2)) + xF(mvi(3))) / 4
            tc = avgC4(mc(mvi(0)), mc(mvi(1)), mc(mvi(2)), mc(mvi(3)))
          Else
            fo.add(New meshface(i, cF + mte.GetEdgeIndex(fi(0), fi(1)), cE + cF + mvi(1), cF + mte.GetEdgeIndex(fi(1), fi(2))))
            fo.add(New meshface(cF + mte.GetEdgeIndex(fi(1), fi(2)), cE + cF + mvi(2), cF + mte.GetEdgeIndex(fi(2), fi(0)), i))
            fo.add(New meshface(cE + cF + mvi(0), cF + mte.GetEdgeIndex(fi(0), fi(1)), i, cF + mte.GetEdgeIndex(fi(2), fi(0))))
            av = (xV(mvi(0)) + xV(mvi(1)) + xV(mvi(2))) / 3
            ae = (xE(mvi(0)) + xE(mvi(1)) + xE(mvi(2))) / 3
            af = (xF(mvi(0)) + xF(mvi(1)) + xF(mvi(2))) / 3
            tc = avgC3(mc(mvi(0)), mc(mvi(1)), mc(mvi(2)))
          End If
          nrm = mfn(i)
          nrm.Unitize()
          vo.add(mf.getfacecenter(i) + nrm * af)
          rv.add(av)
          re.add(ae)
          rf.add(af)
          oc.add(tc)
        Next

        'Edges
        For i = 0 To ce - 1 Step 1

          u = mtv.MeshVertexIndices(mte.GetTopologyVertices(i).I)(0)
          v = mtv.MeshVertexIndices(mte.GetTopologyVertices(i).J)(0)
          p(0) = mv.item(u)
          p(1) = mv.item(v)

          If mte.GetConnectedFaces(i).Count() > 1 Then
            p(2) = mf.GetFaceCenter(mte.GetConnectedFaces(i)(0))
            p(3) = mf.GetFaceCenter(mte.GetConnectedFaces(i)(1))
            p(4) = evalP((p(0) + p(1)) / 2, ( p(2) + p(3)) / 2, (xE(u) / 2 + xE(v) / 2) / 2)
            nes.add(False)
          Else
            p(4) = (p(0) + p(1)) / 2
            nes.add(True)
          End If

          vo.add(p(4))
          rv.add((xV(u) + xV(v)) / 2)
          re.add((xE(u) + xE(v)) / 2)
          rf.add((xF(u) + xF(v)) / 2)
          oc.add(avgC2(mc(u), mc(v)))
        Next

        'Vertices
        For i = 0 To cv - 1 Step 1
          Dim zf,zn As Integer
          Dim cvi As New list(Of Integer)
          Dim q(6) As point3d
          Dim bne As Boolean = False
          q(4) = New point3d(mv(i))

          zf = mv.GetVertexFaces(i).count()
          For j = 0 To zf - 1 Step 1
            q(0) += mF.GetFaceCenter(mV.GetVertexFaces(i)(j))
          Next
          q(0) /= zf

          cvi = mv.GetConnectedVertices(i).ToList()
          cvi.remove(i)
          k = cvi.count()
          zn = 0
          For j = 0 To k - 1 Step 1
            u = mte.GetEdgeIndex(mtv.TopologyVertexIndex(cvi.item((j))), mtv.TopologyVertexIndex(i))
            q(1) = mv.item(mtv.MeshVertexIndices(mte.GetTopologyVertices(u).I)(0))
            q(2) = mv.item(mtv.MeshVertexIndices(mte.GetTopologyVertices(u).J)(0))
            q(3) += (q(1) + q(2)) / 2

            If nes(u) Then
              bne = True
              q(5) += (q(1) + q(2)) / 2
              zn += 1
            End If
          Next
          q(3) /= k

          If bne Then
            If e = 1 Then
              q(6) = (q(4) + q(5) / zn) / 2
            ElseIf e = 2 Then
              If k = 2 Then
                q(6) = q(4)
              Else
                q(6) = evalP(q(4), (q(4) + q(5) / zn) / 2, xV(i))
              End If
            Else
              q(6) = q(4)
            End If
          Else
            q(6) = evalP(q(4), (q(4) * ((zf - 3) / zf)) + (q(3) * (2 / zf)) + (q(0) * (1 / zf)), xV(i))
          End If

          vo.add(q(6))
          rv.add(xV(i))
          re.add(xE(i))
          rf.add(xF(i))
          oc.add(mc(i))

        Next

        Dim mo As New mesh
        mo.Vertices.AddVertices(vo)
        mo.Faces.AddFaces(fo)
        If cb Then mo.VertexColors.AppendColors(oc.toarray())
        mo.FaceNormals.ComputeFaceNormals()
        mo.Normals.ComputeNormals()

        ma = mo
        xV = rv.toarray()
        xE = re.toarray()
        xF = rf.toarray()

        'Loop
      Next
      
      A = ma
    End If
# ---------- m_catmull_clark: VB additional code ----------
  Private Function bC(ByVal arrObj() As Double, ByVal t As Integer)
    Dim intOut As Integer
    If t > uBound(arrObj) Then intOut = uBound(arrObj) Else intOut = t
    Return intOut
  End Function

  Private Function evalP(ByVal op As point3d, ByVal tp As Point3d, ByVal t As Double)
    Return New point3d(op + (tp - op) * t)
  End Function

  Private Function avgC2(ByVal c0 As color, ByVal c1 As color)
    Dim r,g,b As Integer
    r = CInt(((CInt(c0.R) + CInt(c1.R)) / 2))
    g = CInt(((CInt(c0.G) + CInt(c1.G)) / 2))
    b = CInt(((CInt(c0.B) + CInt(c1.B)) / 2))

    If R < 0 Then r = 0 Else If r > 255 Then r = 255
    If G < 0 Then g = 0 Else If r > 255 Then g = 255
    If B < 0 Then b = 0 Else If r > 255 Then b = 255

    Return color.FromArgb(r, g, b)
  End Function

  Private Function avgC3(ByVal c0 As color, ByVal c1 As color, ByVal c2 As color)
    Dim r,g,b As Integer
    r = CInt((CInt(c0.R) + CInt(c1.R) + CInt(c2.R)) / 3)
    g = CInt((CInt(c0.G) + CInt(c1.G) + CInt(c2.G)) / 3)
    b = CInt((CInt(c0.B) + CInt(c1.B) + CInt(c2.B)) / 3)

    If R < 0 Then r = 0 Else If r > 255 Then r = 255
    If G < 0 Then g = 0 Else If r > 255 Then g = 255
    If B < 0 Then b = 0 Else If r > 255 Then b = 255

    Return color.FromArgb(r, g, b)
  End Function

  Private Function avgC4(ByVal c0 As color, ByVal c1 As color, ByVal c2 As color, ByVal c3 As color)
    Dim r,g,b As Integer
    r = CInt((CInt(c0.R) + CInt(c1.R) + CInt(c2.R) + CInt(c3.R)) / 4)
    g = CInt((CInt(c0.G) + CInt(c1.G) + CInt(c2.G) + CInt(c3.G)) / 4)
    b = CInt((CInt(c0.B) + CInt(c1.B) + CInt(c2.B) + CInt(c3.B)) / 4)

    If R < 0 Then r = 0 Else If r > 255 Then r = 255
    If G < 0 Then g = 0 Else If r > 255 Then g = 255
    If B < 0 Then b = 0 Else If r > 255 Then b = 255

    Return color.FromArgb(r, g, b)
  End Function
# ---------- end m_catmull_clark ----------
A = ClusterOutput(m_catmull_clark.A)

# ==== cluster Cluster_2
mesh = ClusterInput()
mesh_edges = MeshEdges(Mesh=mesh)  # -> NakedEdges, InteriorEdges, NonManifoldEdges
data = Data(mesh_edges.NakedEdges)
join_curves = JoinCurves(Curves=data, Preserve=False)
length = Length(Curve=join_curves)
negative = Negative(Value=Slider(20, range=0..100))
sort_list = SortList(Keys=length, ValuesValuesA=join_curves)  # -> Keys, ValuesValuesA
unit_z = UnitZ(Factor=negative)
list_item = ListItem(List=sort_list.ValuesValuesA, Index="-1", Wrap=True)
move = Move(Geometry=list_item, Motion=unit_z)  # -> Geometry, Transform
polygon_center = PolygonCenter(Polyline=move.Geometry)  # -> CenterV, CenterE, CenterA
number_slider = Slider(60, range=0..100)
number_slider_2 = Slider(58, range=0..100)
scale = Scale(Geometry=move.Geometry, Center=polygon_center.CenterV, Factor=Slider(0.756, range=0..1))  # -> Geometry, Transform
divide_curve = DivideCurve(Curve=list_item, Count=number_slider, Kinks=False)  # -> Points, Tangents, Parameters
divide_curve_2 = DivideCurve(Curve=scale.Geometry, Count=number_slider, Kinks=False)  # -> Points, Tangents, Parameters
construct_domain = ConstructDomain(DomainStart=Slider(0, range=0..20), DomainEnd=Slider(4.3, range=0..20))
list_length = ListLength(List=divide_curve_2.Points)
vector_2pt = Vector2Pt(PointA=divide_curve_2.Points, PointB=polygon_center.CenterV, Unitize=False)  # -> Vector, Length
random = Random(Range=construct_domain, Number=list_length, Seed=2)
amplitude = Amplitude(Vector=vector_2pt.Vector, Amplitude=random)
move_2 = Move(Geometry=divide_curve_2.Points, Motion=amplitude)  # -> Geometry, Transform
multiplication = Multiplication(A=random, B=Slider(0, range=0..1))
amplitude_2 = Amplitude(Vector=vector_2pt.Vector, Amplitude=multiplication)
move_3 = Move(Geometry=divide_curve.Points, Motion=amplitude_2)  # -> Geometry, Transform
polyline = PolyLine(Vertices=move_3.Geometry, Closed=True)
polyline_2 = PolyLine(Vertices=move_2.Geometry, Closed=True)
fill_mesh_holes = FillMeshHoles(P=polyline_2)  # -> out, M; inputs P: Curve, clr: list of Color
# ---------- fill_mesh_holes: VB ----------
    Component.Params.Input(0).Name = "Curves"
    Component.Params.Input(0).Description = "A list of open or closed curves"
    Component.Params.Input(1).Name = "Vertex Color "
    Component.Params.Input(1).Description = "A an optional list of colors corresponding to each control point of the input curve, and additional color can be added for the center of the new mesh."

    Component.Params.Output(1).Name = "Mesh"
    Component.Params.Output(1).Description = "If successful, a valid mesh"

    If P IsNot Nothing Then
      Dim ncrv As NurbsCurve
      Dim npts As rhino.Geometry.Collections.NurbsCurvePointList
      Dim pline As polyline

      Dim avgClr,tclr As color
      Dim ov As New list(Of point3d)
      Dim oc As New list(Of Color)
      Dim ofc As New list(Of MeshFace)

      Dim i,j As Integer
      ncrv = P.ToNurbsCurve()
      npts = ncrv.Points
      pline = npts.ControlPolygon

      ov = pline.toarray().ToList()
      If P.IsClosed() Then ov.removeat(ov.count() - 1)
      j = ov.count() - 1
      ov.add(pline.CenterPoint)

      For i = 0 To j Step 1
        If (clr.count()) > 0 Then
          If i > (clr.count() - 1) Then tclr = clr.item(clr.count() - 1) Else tclr = clr.item(i)
          If i = 0 Then avgClr = tclr Else avgClr = colorAverage(avgClr, tclr, 0.5)
          oc.add(tclr)
        End If

        If ((i = j) And (P.IsClosed())) Then
          ofc.add(New meshface(i, 0, j + 1))
        Else
          ofc.add(New meshface(i, i + 1, j + 1))
        End If
      Next

      If (clr.count()) > 0 Then If(j + 1) = (clr.count() - 1) Then oc.add(clr.item(j + 1)) Else oc.add(avgClr)

      Dim msh As New mesh
      msh.Vertices.AddVertices(ov.toarray())
      msh.Faces.AddFaces(ofc.toarray())
      If (clr.count()) > 0 Then msh.VertexColors.AppendColors(oc.toarray())

      M = msh
    End If
# ---------- fill_mesh_holes: VB additional code ----------
  Function colorAverage(ByVal clrA As color, ByVal clrB As color, ByVal t As Double)
    Dim clrOut As color
    Dim R,G,B As Integer

    If CInt(clrA.r * t + clrB.r * (1 - t)) > 255 Then
      R = 255
    ElseIf CInt(clrA.r * t + clrB.r * (1 - t)) < 0 Then
      R = 0
    Else
      R = CInt(clrA.r * t + clrB.r * (1 - t))
    End If

    If CInt(clrA.g * t + clrB.g * (1 - t)) > 255 Then
      G = 255
    ElseIf CInt(clrA.g * t + clrB.g * (1 - t)) < 0 Then
      G = 0
    Else
      G = CInt(clrA.g * t + clrB.g * (1 - t))
    End If

    If CInt(clrA.b * t + clrB.b * (1 - t)) > 255 Then
      B = 255
    ElseIf CInt(clrA.b * t + clrB.b * (1 - t)) < 0 Then
      B = 0
    Else
      B = CInt(clrA.b * t + clrB.b * (1 - t))
    End If

    clrOut = color.fromargb(R, G, B)
    Return clrOut
  End Function
# ---------- end fill_mesh_holes ----------
mesh_loft = MeshLoft(P=[polyline, polyline_2], T=Slider(0, range=0..3), O=False, F=False, C=False)  # -> out, M; inputs P: list of Curve, clr: list
# ---------- mesh_loft: VB ----------
    Component.Params.Input(0).Name = "Curves"
    Component.Params.Input(0).Description = "A list of open or closed curves"
    Component.Params.Input(1).Name = "Face Type"
    Component.Params.Input(1).Description = "0=Quad, 1=Triangulate, 2=Zig Zag, 3=Wave, 4=Diamond, 5=Shortest, 6=Longest"
    Component.Params.Input(2).Name = "Attempt Orientation"
    Component.Params.Input(2).Description = "An optional boolean input which if true will attempt to shift each curves control points to reduce torsion"
    Component.Params.Input(3).Name = "Flip"
    Component.Params.Input(3).Description = "An optional boolean input which if true will reverse the direction of triangulation when possible"
    Component.Params.Input(4).Name = "Closed"
    Component.Params.Input(4).Description = "An optional boolean input which if true will connect the last curve back to the first"
    Component.Params.Input(5).Name = "Color [Vertex]"
    Component.Params.Input(5).Description = "An optional color or list of colors corresponding to each new vertex of the mesh"

    Component.Params.Output(1).Name = "Mesh"
    Component.Params.Output(1).Description = "If successful, a valid mesh"

    If P.count() > 1 Then
      Dim MO As New mesh
      Dim mt As New mesh
      Dim i,j,k,r,s,n,u,v,w,x,y As Integer
      Dim arrFc As New list(Of MeshFace)
      Dim arrClr As New list(Of color)
      Dim blnC As New list(Of Boolean)
      Dim us() As Integer
      Dim cen(2), tpt(1) As point3d
      Dim mv As Rhino.Geometry.Collections.MeshVertexList
      Dim oc As New list(Of color)
      mv = mt.Vertices

      'Optional Colors
      Dim tclr As New datatree(Of color)
      Dim tcx As Integer
      For j = 0 To P.count() - 1 Step 1
        Dim tncr As New nurbscurve(P.item(j).tonurbscurve)
        Dim tpln As New polyline(tncr.Points.ControlPolygon())

        Dim cs As New dictionary(Of Integer,Object)
        Dim blnX As New Boolean
        If ((j > clr.count()) Or (clr.count() = 0)) Then
          cs.add(0, color.White)
          cs.add(1, color.White)
        Else
          cs = clr.item(j)
          If cs.count() > 0 Then blnX = True
        End If

        If blnX Then
          For k = 0 To cs.count() - 2 Step 1
            tclr.add(color.FromArgb(cs.item(k).R, cs.item(k).G, cs.item(k).B), New gh_path(j))
          Next
        End If

        If tpln.count() > cs.count() Then
          tcx = cs.count() - 1
          For k = cs.count() To tpln.count() - 2 Step 1
            tclr.add(color.FromArgb(cs.item(tcx).R, cs.item(tcx).G, cs.item(tcx).B), New gh_path(j))
          Next
        End If
      Next

      'Vertices
      s = 0
      If C Then y = 0 Else y = 1
      If f Then x = 0 Else x = 1
      For i = 0 To P.count() - y Step 1
        If i < P.count() Then
          Dim ncrv As New nurbscurve(P.item(i).tonurbscurve())
          Dim npts As Rhino.Geometry.Collections.NurbsCurvePointList
          npts = ncrv.Points()
          Dim pline As polyline = npts.ControlPolygon
          cen(1) = pline.CenterPoint
          If i = 0 Then cen(2) = cen(1)
          If P.item(i).IsClosed() Then
            pline.RemoveAt(pline.Count() - 1)
            blnC.add(True)
          Else
            blnC.add(False)
          End If
          v = pline.Count() - 1
          If o Then
            If (i > 0) Then
              If (blnC.item(i) And blnC.item(i - 1)) Then pline = radSrtPt(cen(1), tpt(0), tpt(1), cen(0), pline)(0)
            Else
              Dim ncrvA As New nurbscurve(P.item(1).tonurbscurve())
              Dim plineA As polyline = ncrvA.points.ControlPolygon
              If P.item(1).IsClosed() Then plineA.RemoveAt(plineA.Count() - 1)
              If (blnC.item(i) And P.item(1).isclosed()) Then pline = radSrtPt(plineA.CenterPoint, pline.item(0), pline.item(pline.count() - 1), pline.CenterPoint, pline)(0)
            End If
          End If

          tpt(0) = pline.item(0)
          tpt(1) = pline.item(pline.count() - 1)
          cen(0) = cen(1)

          mv.AddVertices(pline.ToArray())
          oc.addrange(tclr.branch(i))
          n = s
          us = Series(pline.count() - 1)
        Else
          If o Then
            Dim ncrvA As New nurbscurve(P.item(0).tonurbscurve())
            Dim plineA As polyline = ncrvA.points.ControlPolygon
            If P.item(0).IsClosed() Then plineA.RemoveAt(plineA.Count() - 1)
            us = radSrtPt(cen(2), tpt(0), tpt(1), cen(0), plineA)(1)
          Else
            us = Series(r)
          End If
          n = -1
          If P.item(0).isclosed() Then blnC.add(True) Else blnC.add(False)
        End If

        Dim tu(),tv() As Integer
        If i > 0 Then
          If i = P.count() Then v = r
          If blnC.item(i) Then tv = appendprepend(v) Else tv = prepend(v)
          If blnC.item(i - 1) Then tu = appendprepend(u) Else tu = prepend(u)
          If ubound(tu) > ubound(tv) Then k = ubound(tu) Else k = ubound(tv)
          Dim blnU, blnV As New Boolean
          For j = 1 To k Step 1

            If ((j < ubound(tv)) And (j < ubound(tu))) Then
              'This is where faces with 4 valid vertices go

              Dim d(1) As Double
              Dim viD(3) As Double

              viD(0) = s - u + tu(j)
              viD(1) = s - u + tu(j + 1)
              viD(2) = n + 1 + us(tv(j + 1))
              viD(3) = n + 1 + us(tv(j))

              d(0) = mv.item(viD(0)).distanceto(mv.item(viD(2)))
              d(1) = mv.item(viD(1)).distanceto(mv.item(viD(3)))

              'set edge pattern
              If t = 1 Then'Triangulate
                w = x
              ElseIf t = 2 Then 'ZigZag
                If ((i + 1 + x) Mod 2) Then w = 1 Else w = 0
              ElseIf t = 3 Then 'Wave
                If ((j + 1 + x) Mod 2) Then w = 1 Else w = 0
              ElseIf t = 4 Then 'Diamond
                If ((i + 1 + x) Mod 2) Then
                  If ((j + 1) Mod 2) Then w = 1 Else w = 0
                Else
                  If ((j + 1) Mod 2) Then w = 0 Else w = 1
                End If
              ElseIf t = 5 Then 'Shortest
                If d(0) > d(1) Then w = 0 Else w = 1
              ElseIf t = 6 Then 'Longest Length
                If d(0) > d(1) Then w = 1 Else w = 0
              Else
                w = 2
              End If


              'Assign Faces
              If w = 0 Then
                arrFc.add(New meshface(viD(0), viD(1), viD(3)))
                arrFc.add(New meshface(viD(1), viD(2), viD(3)))
              ElseIf w = 1 Then
                arrFc.add(New meshface(viD(0), viD(1), viD(2)))
                arrFc.add(New meshface(viD(0), viD(2), viD(3)))
              Else
                arrFc.add(New meshface(viD(0), viD(1), viD(2), viD(3)))
              End If

            ElseIf ((j < ubound(tv))) Then
              arrFc.add(New meshface(s - u + tu(ubound(tu)), n + 1 + us(tv(j + 1)), n + 1 + us(tv(j))))
            ElseIf ((j < ubound(tu)))  Then
              arrFc.add(New meshface(s - u + tu(j), s - u + tu(j + 1), n + 1 + us(tv(ubound(tv)))))
            End If
          Next

        Else
          r = v
        End If
        u = v
        s = mv.count() - 1
      Next

      MO.Vertices.AddVertices(mv)
      If clr.count() > 0 Then MO.VertexColors.AppendColors(oc.toarray())
      MO.Faces.AddFaces(arrFc.toarray())
      MO.Normals.ComputeNormals()
      MO.FaceNormals.ComputeFaceNormals()

      M = MO
    End If
# ---------- mesh_loft: VB additional code ----------
  Private Function appendprepend(ByVal i As Integer)
    Dim srsEnum As IEnumerable(Of Integer) = Enumerable.Range(0, i + 1)
    Dim arrVal As New list(Of Integer)
    arrVal = srsEnum.tolist()
    arrVal.add(0)
    arrVal.insert(0, i)
    Return arrVal.toarray()
  End Function

  Private Function prepend(ByVal i As Integer)
    Dim srsEnum As IEnumerable(Of Integer) = Enumerable.Range(0, i + 1)
    Dim arrVal As New list(Of Integer)
    arrVal = srsEnum.tolist()
    arrVal.insert(0, i)
    Return arrVal.toarray()
  End Function

  Private Function Series(ByVal i As Integer)
    Dim srsEnum As IEnumerable(Of Integer) = Enumerable.Range(0, i + 1)
    Dim arrVal As New list(Of Integer)
    arrVal = srsEnum.tolist()
    Return arrVal.toarray()
  End Function

  Private Function radSrtPt(ByVal cenA As point3d, ByVal ptA As point3d, ByVal ptB As point3d, ByVal cenB As point3d, ByVal ptList As polyline)
    Dim i As Integer
    Dim arrOut() As point3d
    Dim vecA, vecB, vecC As New Vector3d
    vecA = (ptA + ptB) / 2 - cenB
    vecB = cenB - cenA
    vecC = vector3d.CrossProduct(vecB, vecA)

    Dim pln As New plane(cenB, vecB, vecA)
    pln = New plane(cenB, pln.YAxis, pln.ZAxis)
    Dim ptTemp As New list(Of point3d)
    Dim dblAng(),dblAngA() As Double
    Dim intSrt() As Integer

    ReDim dblAng(ptList.count() - 1)
    ReDim dblAngA(ptList.count() - 1)
    ReDim intSrt(ptList.count() - 1)

    For i = 0 To ptList.count() - 1 Step 1
      Dim vec As vector3d
      ptTemp.add(ptList.item(i))
      intSrt(i) = i
      vec = pln.ClosestPoint(ptList.item(i)) - cenA
      dblAng(i) = vector3d.VectorAngle(vec, pln.XAxis, pln)
      dblAngA(i) = dblAng(i)
    Next

    arrOut = ptTemp.toarray()
    array.Sort(dblAng, arrOut)
    array.Sort(dblAngA, intSrt)

    Dim plineO As New Polyline(arrOut)

    Return {plineO,intSrt}
  End Function
# ---------- end mesh_loft ----------
mesh_join = MeshJoin(Meshes=[fill_mesh_holes.M, mesh_loft.M])
weighted_loop_subdivision = WeightedLoopSubdivision(M=mesh_join, L=Slider(2, range=0..10), E=1, TE=1, TV=1)  # -> out, A; inputs M: Mesh, TE: list, TV: list
# ---------- weighted_loop_subdivision: VB ----------
    Component.Params.Input(0).Name = "Mesh"
    Component.Params.Input(0).Description = "An open or closed mesh whose faces should be triangular, all quad faces will be triangulated automatically"
    Component.Params.Input(1).Name = "Loops"
    Component.Params.Input(1).Description = "The number of iterations applied to each face"
    Component.Params.Input(2).Name = "Edge Type"
    Component.Params.Input(2).Description = "0=Fixed, 1=Smooth, 2=Fixed Corners"
    Component.Params.Input(3).Name = "Edge Weight [Vertex]"
    Component.Params.Input(3).Description = "An optional list of double values which overides the percent between the existing edge midpoint and the new smoothed vertex (1=Default)"
    Component.Params.Input(4).Name = "Vertex Weight [Vertex]"
    Component.Params.Input(4).Description = "An optional list of double values which overides the percent between the existing vertex and the new smoothed vertex (1=Default)"

    Component.Params.Output(1).Name = "Mesh"
    Component.Params.Output(1).Description = "If successful, a valid mesh"

    If m IsNot Nothing Then
      Dim ma As New mesh
      Dim i,lp As Integer
      Dim txV,txE As New list(Of Double)
      Dim xV(),xE() As Double
      Dim bn As Boolean
      Dim cb As Boolean

      'input mesh to the looped mesh
      m.weld(math.pi)
      If m.Faces.QuadCount() > 0 Then m.Faces.ConvertQuadsToTriangles
      ma = m

      ' match multiplier and color values to vertex count
      xV = TV.toarray()
      xE = TE.toarray()
      For i = 0 To m.Vertices.count() - 1 Step 1
        txV.add(xV(bC(xV, i)))
        txE.add(xE(bC(xE, i)))
      Next
      xV = txV.toarray()
      xE = txE.toarray()

      bn = m.IsClosed() = False

      For lp = 0 To L - 1 Step 1

        Dim mv As Rhino.Geometry.Collections.MeshVertexList
        Dim mf As Rhino.Geometry.Collections.MeshFaceList
        Dim mfn As Rhino.Geometry.Collections.MeshFaceNormalList
        Dim mc As Rhino.Geometry.Collections.MeshVertexColorList
        Dim mte As Rhino.Geometry.Collections.MeshTopologyEdgeList
        Dim mtv As Rhino.Geometry.Collections.MeshTopologyVertexList
        Dim mnv() As Boolean
        Dim nes As New list(Of Boolean)
        Dim pv() As point3d

        If ma.VertexColors.Count() > 0 Then
          cb = True
        Else
          cb = False
          ma.VertexColors.CreateMonotoneMesh(color.LightBlue)
        End If

        mv = ma.Vertices
        mf = ma.Faces
        mfn = ma.FaceNormals
        mc = ma.VertexColors
        mte = ma.TopologyEdges
        mtv = ma.TopologyVertices

        pv = mv.ToPoint3dArray
        mnv = ma.GetNakedEdgePointStatus

        Dim vo,vt As New list(Of point3d)
        Dim fo As New list(Of MeshFace)
        Dim j,k,u,v,cf,ce,cv As Integer
        Dim fi() As Integer
        Dim p(3) As point3d
        Dim mvi(3) As Integer
        Dim rv,re As New list(Of Double)
        Dim oc As New list(Of color)

        cv = mv.count()
        ce = mte.count()
        cf = mf.count()

        'Faces
        For i = 0 To cf - 1 Step 1
          fi = mtv.IndicesFromFace(i)
          mvi(0) = mtv.MeshVertexIndices(fi(0))(0)
          mvi(1) = mtv.MeshVertexIndices(fi(1))(0)
          mvi(2) = mtv.MeshVertexIndices(fi(2))(0)

          fo.add(New meshface(mte.GetEdgeIndex(fi(0), fi(1)), mte.GetEdgeIndex(fi(1), fi(2)), mte.GetEdgeIndex(fi(2), fi(0))))

          fo.add(New meshface(mte.GetEdgeIndex(fi(0), fi(1)), ce + mvi(1), mte.GetEdgeIndex(fi(1), fi(2))))
          fo.add(New meshface(mte.GetEdgeIndex(fi(1), fi(2)), ce + mvi(2), mte.GetEdgeIndex(fi(2), fi(0))))
          fo.add(New meshface(mte.GetEdgeIndex(fi(2), fi(0)), ce + mvi(0), mte.GetEdgeIndex(fi(0), fi(1))))
        Next

        'Edges
        For i = 0 To ce - 1 Step 1
          Dim cfi() As Integer
          Dim ta,tb As New list(Of Integer)
          Dim cei As Rhino.IndexPair

          cfi = mte.GetConnectedFaces(i)
          cei = mte.GetTopologyVertices(i)
          u = mtv.MeshVertexIndices(cei.I)(0)
          v = mtv.MeshVertexIndices(cei.J)(0)
          p(0) = (pv(u) + pv(v)) / 2

          If ubound(cfi) > 0 Then
            ta = mf.GetTopologicalVertices(cfi(0)).tolist()
            ta.remove(cei.I)
            ta.remove(cei.J)

            tb = mf.GetTopologicalVertices(cfi(1)).tolist()
            tb.remove(cei.I)
            tb.remove(cei.J)

            p(1) = pv(mtv.meshvertexindices(ta(0))(0))
            p(2) = pv(mtv.meshvertexindices(tb(0))(0))
            p(3) = evalP(p(0), pv(u) * 3 / 8 + pv(v) * 3 / 8 + p(1) / 8 + p(2) / 8, (xe(u) + xe(v)) / 2)

            nes.add(False)
          Else
            p(3) = p(0)
            nes.add(True)
          End If

          vo.add(p(3))
          vt.add(p(3))
          rv.add((xV(u) + xV(v)) / 2)
          re.add((xE(u) + xE(v)) / 2)
          oc.add(avgC2(mc(u), mc(v)))
        Next

        'Vertices
        For i = 0 To cv - 1 Step 1
          Dim tvi As Integer
          Dim cvi As New list(Of Integer)
          Dim q(2) As point3d
          Dim bne As Boolean = False

          tvi = mtv.TopologyVertexIndex(i)

          mtv.SortEdges(tvi)

          cvi = mtv.ConnectedTopologyVertices(tvi).tolist()
          cvi.remove(tvi)
          k = cvi.count()

          For j = 0 To k - 1 Step 1
            u = mte.GetEdgeIndex(tvi, cvi.item(j))
            q(0) += pv(mtv.MeshVertexIndices(cvi.item(j))(0))

            If nes(u) Then
              bne = True
              q(2) += pv(mtv.MeshVertexIndices(cvi.item(j))(0))
            End If
          Next

          If bne Then
            If e = 0 Then
              q(1) = pv(i)
            ElseIf e = 2 Then
              If k = 2 Then
                q(1) = pv(i)
              Else
                q(1) = evalP(pv(i), q(2) / 2, 0.25)
              End If
            Else
              q(1) = evalP(pv(i), q(2) / 2, 0.25)
            End If
          Else
            If k = 3 Then
              q(1) = evalp(pv(i), q(0) / k, xv(i) * 9 / 16)
            Else
              q(1) = evalp(pv(i), q(0) / k, xv(i) * 3 / 8)
            End If
          End If


          vo.add(q(1))
          rv.add(xV(i))
          re.add(xE(i))
          oc.add(mc(i))

        Next

        Dim mo As New mesh
        mo.Vertices.AddVertices(vo)
        mo.Faces.AddFaces(fo)
        If cb Then mo.VertexColors.AppendColors(oc.toarray())
        mo.FaceNormals.ComputeFaceNormals()
        mo.Normals.ComputeNormals()

        ma = mo
        xV = rv.toarray()
        xE = re.toarray()

        'Loop
      Next
      A = ma
    End If
# ---------- weighted_loop_subdivision: VB additional code ----------
  Private Function bC(ByVal arrObj() As Double, ByVal t As Integer)
    Dim intOut As Integer
    If t > uBound(arrObj) Then intOut = uBound(arrObj) Else intOut = t
    Return intOut
  End Function

  Private Function evalP(ByVal op As point3d, ByVal tp As Point3d, ByVal t As Double)
    Return New point3d(op + (tp - op) * t)
  End Function

  Private Function avgC2(ByVal c0 As color, ByVal c1 As color)
    Dim r,g,b As Integer
    r = CInt(((CInt(c0.R) + CInt(c1.R)) / 2))
    g = CInt(((CInt(c0.G) + CInt(c1.G)) / 2))
    b = CInt(((CInt(c0.B) + CInt(c1.B)) / 2))

    If R < 0 Then r = 0 Else If r > 255 Then r = 255
    If G < 0 Then g = 0 Else If r > 255 Then g = 255
    If B < 0 Then b = 0 Else If r > 255 Then b = 255

    Return color.FromArgb(r, g, b)
  End Function
# ---------- end weighted_loop_subdivision ----------
deconstruct_mesh = DeconstructMesh(Mesh=weighted_loop_subdivision.A)  # -> Vertices, Faces, Colours, Normals
deconstruct = Deconstruct(Point=deconstruct_mesh.Vertices)  # -> XComponent, YComponent, ZComponent
data_2 = Data(Slider(0.5, range=-2..2))
data_3 = Data(Slider(-0.5, range=-2..2))
construct_domain_2 = ConstructDomain(DomainStart=data_2, DomainEnd=data_3)
bounds = Bounds(Numbers=deconstruct.ZComponent)
remap_numbers = RemapNumbers(Value=deconstruct.ZComponent, Source=bounds, Target=construct_domain_2)  # -> Mapped, Clipped
graph_mapper = GraphMapper(
    remap_numbers.Mapped,
    x0=-0.5,
    x1=0.5,
    y0=-0.5,
    y1=0.5,
    amplitude=0.1383460164,
    container_name="Perlin",
    decay=0.7244101763,
    frequency=0.2401840687,
    x_offset=0.5369703174,
    y_offset=0.4195483327)
gradient = Gradient(LowerLimit=-0.5, UpperLimit=0.5, Parameter=graph_mapper, stops=[0.0306: RGB(117, 92, 54), 1: RGB(153, 124, 101)])
jitter = Jitter(List=gradient, Jitter=Slider(0.096, range=0..1), Seed=2)  # -> Values, Indices
construct_mesh = ConstructMesh(Vertices=deconstruct_mesh.Vertices, Faces=deconstruct_mesh.Faces, Colours=jitter.Values)
mesh_2 = ClusterOutput(construct_mesh)

# ==== cluster Cluster_3
number_slider = Slider(4.644, range=0..10)
d1 = ClusterInput()
d2 = ClusterInput()
G = ClusterInput()
merge = Merge(Data1=d1, Data2=d2)
popgeo = PopulateGeometry(Geometry=G, Count=100, Seed=1)
C = ClusterInput()
neg = Negative(Value=number_slider)
offset = OffsetCurve(Curve=C, Distance=number_slider, Corners=1)
multiplication = Multiplication(A=number_slider, B=Slider(8, range=0..10))
pull = PullPoint(Point=popgeo, Geometry=merge, ClosestOnly=True)  # -> ClosestPoint, Distance
C_2 = ClusterInput()
offset_2 = OffsetCurve(Curve=C_2, Distance=neg, Corners=1)
sort = SortList(Keys=pull.Distance, ValuesA=popgeo)  # -> Keys, flatten(ValuesA)
item = ListItem(List=sort.ValuesA, Index=0, Wrap=True)  # -> Item1, Item
cir = Circle(Plane=flatten(item.Item1), Radius=multiplication)
trim = TrimWithRegions(Curve=[offset_2, offset], Regions=cir)  # -> Inside, Outside
reb = RebuildCurve(Curve=cir, Degree="1", Count=Slider(10, range=0..10), Tangents=False)
data = Data(flatten(reb))
data_2 = Data(flatten(trim.Inside))
ccx = CurveCurve(CurveA=data, CurveB=graft(data_2), UseTasks=False)  # -> Points, simplify(ParamsA), simplify(ParamsB)
shatter = Shatter(Curve=reb, Parameters=flatten(ccx.ParamsA))
len = Length(Curve=shatter)
trim_2 = TrimWithRegions(Curve=trim.Inside, Regions=reb)  # -> Inside, Outside
sort_2 = SortList(Keys=len, ValuesA=shatter)  # -> Keys, ValuesA
item_2 = ListItem(List=sort_2.ValuesA, Index=0, Wrap=True)  # -> Item1, Item, Item1_2, Item2
data_3 = Data([item_2.Item, item_2.Item1_2])
merge_2 = Merge(Data1=flatten(trim_2.Inside), Data2=flatten(data_3))
join = JoinCurves(Curves=merge_2, Preserve=False)
fillet = Fillet(Curve=join, Radius=Slider(3, range=0..3))
C_3 = ClusterOutput(fillet)

# ==== cluster Cluster_4
E = ClusterInput()
boundary = BoundarySurfaces(Edges=E)
mesh = Mesh(boundary)
wbcatmullclark = WeaverbirdsCatmullClarkSubdivision(MeshCurves=mesh, Level=1, SmoothNakedEdges=1)
mesh_2 = Mesh(wbcatmullclark)
G = ClusterInput()
gate = StreamGate(Stream=mesh_2, Gate=G)  # -> Target0, Target1
G_2 = ClusterInput()
N = ClusterInput()
C = ClusterInput()
demesh = DeconstructMesh(Mesh=gate.Target1)  # -> Vertices, Faces, Colours, Normals
volume = Volume(Geometry=G_2)  # -> Volume, Centroid
series = Series(Start=0, Step=N, Count=C)
project = Project(Geometry=volume.Centroid, Plane=boundary)  # -> Geometry, Transform
item = ListItem(List=demesh.Vertices, Index=series, Wrap=True)
pt = Point(project.Geometry)
xy = XYPlane(Origin=item)
lng = ListLength(List=item)
random = Random(Range=Domain(0, 180), Number=lng, Seed=2)
rotate = Rotate(Geometry=xy, Angle=degrees(random), Plane=xy)  # -> Geometry, Transform
G_3 = ClusterInput()
orient = Orient(Geometry=G_3, Source=pt, Target=rotate.Geometry)  # -> Geometry, Transform
mjoin = MeshJoin(Meshes=orient.Geometry)  # -> flatten(Mesh)
M = ClusterOutput(mjoin)

# ==== cluster Cluster_5
E = ClusterInput()
boundary = BoundarySurfaces(Edges=E)
mesh = Mesh(boundary)
demesh = DeconstructMesh(Mesh=mesh)  # -> Vertices, Faces, Colours, Normals
G = ClusterInput()
pull = PullPoint(Point=simplify(demesh.Vertices), Geometry=simplify(flatten(G)), ClosestOnly=True)  # -> ClosestPoint, Distance
neg = Negative(Value=".500")
data = Data(".500")
data_2 = Data(neg)
bnd = Bounds(Numbers=pull.Distance)
dom = ConstructDomain(DomainStart=data, DomainEnd=data_2)
remap = RemapNumbers(Value=pull.Distance, Source=bnd, Target=dom)  # -> Mapped, Clipped
graph = GraphMapper(
    remap.Mapped,
    x0=-0.5,
    x1=0.5,
    y0=-0.5,
    y1=0.5,
    amplitude=0.467892766,
    container_name="Perlin",
    decay=0.4293148518,
    frequency=0.3843113184,
    x_offset=0.1856071353,
    y_offset=0.7128851414)
gradient = Gradient(LowerLimit=-0.5, UpperLimit=0.5, Parameter=graph, stops=[0.324: RGB(105, 115, 65), 1: RGB(32, 69, 39)])
conmesh = ConstructMesh(Vertices=demesh.Vertices, Faces=demesh.Faces, Colours=gradient)
m_catmull_clark = WeightedCatmullClarkSubdivision(M=conmesh, L=Slider(1, range=0..10), E=Slider(1, range=0..10), DF=0, TE=1, TV=1)  # -> out, A; inputs M: Mesh, DF: list, TE: list, TV: list; same code as m_catmull_clark
mblur = BlurMesh(Mesh=m_catmull_clark.A, Iterations=Slider(0, range=0..5))
M = ClusterOutput(mblur)

# ==== cluster Cluster_6
C = ClusterInput()
E = ClusterInput()
explode = Explode(Curve=C, Recursive=True)  # -> Segments, Vertices
boundary = BoundarySurfaces(Edges=E)
qrsettings = QuadRemeshSettings(
    TargetCount=Slider(120, range=0..1000),
    AdaptiveSize=0,
    AdaptiveCount=invert(False),
    HardEdges=False,
    SeamEdges=0,
    Symmetry=0,
    GuideCurves=0)
mesh = MeshBrep(
    Brep=boundary,
    Settings={GridMaxCount=0, GridMinCount=16, JaggedSeams=False, MaxEdgeLength=0, MinEdgeLength=0.0001, MinTolerance=0, Refine=True, RefineAngle=0, RelativeTolerance=0.65, SimplePlanes=True, Tolerance=0})
cull = CullPattern(List=explode.Segments, CullPattern=[True, False, False])
qrmesh = QuadRemesh(Mesh=mesh, Settings=qrsettings)
strength = ClusterInput()

nv = NakedVertices(Mesh=qrmesh)  # -> ClothedIndex, NakedIndex, ClothedPts, NakedPts
pull = PullPoint(Point=nv.NakedPts, Geometry=cull, ClosestOnly=True)  # -> ClosestPoint, Distance
edgelengths = EdgeLengths(Mesh=qrmesh, LengthFactor="1", Strength=1)
smaller = SmallerThan(FirstNumber=pull.Distance, SecondNumber=Slider(1e-05, range=0..1e-05))  # -> SmallerThan, OrEqualTo
cull_2 = CullPattern(List=pull.ClosestPoint, CullPattern=smaller.OrEqualTo)
pt = Point(cull_2)
vertexloads = VertexLoads(Mesh=qrmesh, Strength=strength)
anchor = Anchor(Point=pt, Strength=10000)
show = Show(G=qrmesh)
merge = Merge(Data1=show, Data2=anchor, Data3=vertexloads, Data4=edgelengths)
zombiesolver = ZombieSolver(GoalObjects=merge, Threshold=1e-10, Tolerance=0.0001, MaxIterations=50000)  # -> I, V, O

O = ClusterOutput(zombiesolver.O)

# ==== cluster Cluster_8
M = ClusterInput()
G = ClusterInput()
E = ClusterInput()
G_2 = ClusterInput()
data = ClusterInput()
N = ClusterInput()
C = ClusterInput()
B = ClusterInput()

weld = WeldMesh(Mesh=M, Angle=3.141592654)
volume = Volume(Geometry=G)  # -> Volume, Centroid
project = Project(Geometry=volume.Centroid, Plane=PlaneXY(0, 0, 0))  # -> Geometry, Transform
boundary = BoundarySurfaces(Edges=E)
pt = Point(project.Geometry)
demesh = DeconstructMesh(Mesh=weld)  # -> Vertices, Faces, Colours, Normals
mesh = Mesh(boundary)
pdecon = Deconstruct(Point=demesh.Vertices)  # -> XComponent, YComponent, ZComponent
m_catmull_clark = WeightedCatmullClarkSubdivision(M=mesh, L=Slider(1, range=0..10), E=Slider(1, range=0..10), DF=0, TE=1, TV=1)  # -> out, A; inputs M: Mesh, DF: list, TE: list, TV: list; same code as m_catmull_clark
bnd = Bounds(Numbers=pdecon.ZComponent)
mesh_2 = Mesh(m_catmull_clark.A)
remap = RemapNumbers(Value=pdecon.ZComponent, Source=bnd, Target=Domain(0, 1))  # -> Mapped, Clipped
gate = StreamGate(Stream=mesh_2, Gate=G_2)  # -> Target0, Target1
gradient = Gradient(
    LowerLimit=0,
    UpperLimit=1,
    Parameter=remap.Mapped,
    stops=[0: RGB(74, 65, 42), 0.359: RGB(130, 113, 4), 0.789: RGB(42, 71, 9)])
demesh_2 = DeconstructMesh(Mesh=gate.Target1)  # -> Vertices, Faces, Colours, Normals
data_2 = Data(data)
cluster = Cluster_7(data=gradient)
pull = PullPoint(Point=demesh_2.Vertices, Geometry=data_2, ClosestOnly=True)  # -> ClosestPoint, Distance
sort = SortList(Keys=pull.Distance, ValuesA=demesh_2.Vertices)  # -> Keys, ValuesA
series = Series(Start=0, Step=N, Count=C)
filter = StreamFilter(Gate=0, Stream0=gradient, Stream1=cluster)
item = ListItem(List=sort.ValuesA, Index=series, Wrap=True)
mcol = MeshColours(Mesh=weld, Colours=filter)
lng = ListLength(List=item)
xy = XYPlane(Origin=item)
random = Random(Range=Domain(0, 180), Number=lng, Seed=2)
mblur = BlurMesh(Mesh=mcol, Iterations=Slider(1, range=0..5))
multiplication = Multiplication(A=Slider(0.8, range=0..2))
multiplication_2 = Multiplication(A=Slider(2.5, range=0..5), B=B)
rotate = Rotate(Geometry=xy, Angle=degrees(random), Plane=xy)  # -> Geometry, Transform
dom = ConstructDomain(DomainStart=multiplication, DomainEnd=multiplication_2)
orient = Orient(Geometry=mblur, Source=pt, Target=rotate.Geometry)  # -> Geometry, Transform
random_2 = Random(Range=dom, Number=lng, Seed=2)
scale = Scale(Geometry=orient.Geometry, Center=rotate.Geometry, Factor=random_2)  # -> Geometry, Transform
mjoin = MeshJoin(Meshes=scale.Geometry)  # -> flatten(Mesh)

M_2 = ClusterOutput(mjoin)

# ==== cluster Cluster_9
curve = ClusterInput()
curve_2 = Curve(curve)
list_length = ListLength(List=curve_2)
repeat_data = RepeatData(Data=ColourSwatch(SwatchColor=RGB(255, 0, 123)), Length=list_length)
c_script = CSharpScript(crv=curve_2, color=repeat_data)  # -> out, A; inputs crv: Curve, color: Color
# ---------- c_script: C# ----------
    var c = color.R + "," + color.G + "," + color.B;
    crv.SetUserString("color", c);
    A = crv;
# ---------- end c_script ----------
A = ClusterOutput(c_script.A)

# ==== cluster Cluster_10
M = ClusterInput()
nv = NakedVertices(Mesh=M)  # -> ClothedIndex, NakedIndex, ClothedPts, NakedPts
S = ClusterInput()
G = ClusterInput()
plfit = PlaneFit(Points=nv.ClothedPts)  # -> Plane, Deviation
gate = StreamGate(Stream=S, Gate=G)  # -> Target0, Target1
L = ClusterInput()
mshadow = MeshShadow(Mesh=gate.Target1, Light=L, Plane=plfit.Plane)
data = Data(flatten(mshadow))
pt = ClusterInput()
data_2 = ClusterOutput(data)
curvepoint = PointOnCurve(data, parameter=0.5)
pt_2 = Point(pt)
pull = PullPoint(Point=curvepoint, Geometry=pt_2, ClosestOnly=True)  # -> ClosestPoint, Distance
bnd = Bounds(Numbers=pull.Distance)
remap = RemapNumbers(Value=pull.Distance, Source=bnd, Target=Domain(0, 1))  # -> flatten(Mapped), Clipped
gradient = Gradient(LowerLimit=0, UpperLimit=1, Parameter=remap.Mapped, stops=[0: RGB(26, 26, 26), 0.5: RGB(54, 54, 54), 1: RGB(82, 82, 82)])
C = ClusterOutput(gradient)

# ==== cluster Cluster_11
E = ClusterInput()
boundary = BoundarySurfaces(Edges=E)
curve = ClusterInput()
length = Length(Curve=curve)
multiplication = Multiplication(A=length, B=Slider(0.1, range=0..1))
custom_mesh_settings = SettingsCustom(
    StitchSeams=True,
    SimplePlanes=False,
    Refine=True,
    MinCount=16,
    MaxCount=400,
    AspectRatio=20,
    MaxDistance=0,
    MaxAngle=20,
    MinEdge=multiplication,
    MaxEdge=multiplication)
mesh = MeshBrep(Brep=boundary, Settings=custom_mesh_settings)
mesh_edges = MeshEdges(Mesh=mesh)  # -> simplify(NakedEdges), InteriorEdges, NonManifoldEdges
deconstruct_mesh = DeconstructMesh(Mesh=mesh)  # -> Vertices, Faces, Colours, Normals
join_curves = JoinCurves(Curves=mesh_edges.NakedEdges, Preserve=False)  # -> simplify(Curves)
pull_point = PullPoint(Point=simplify(deconstruct_mesh.Vertices), Geometry=simplify(graft(join_curves)), ClosestOnly=True)  # -> ClosestPoint, Distance
data = Data(Slider(0, range=0..1))
data_2 = Data(Slider(2.905, range=0..10))
construct_domain = ConstructDomain(DomainStart=data, DomainEnd=data_2)
bounds = Bounds(Numbers=pull_point.Distance)
remap_numbers = RemapNumbers(Value=pull_point.Distance, Source=bounds, Target=construct_domain)  # -> Mapped, Clipped
graph_mapper = GraphMapper(
    remap_numbers.Mapped,
    x0=0,
    x1=5,
    y0=0,
    y1=5,
    container_name="Gaussian",
    factor=0.1717079282,
    mean=0.5004379749,
    sdev=0.2594164014)
gradient = Gradient(
    LowerLimit=-0.5,
    UpperLimit=0.5,
    Parameter=reverse(graph_mapper),
    stops=[0.445: RGB(99, 99, 99), 0.773: RGB(87, 87, 87), 1: RGB(71, 71, 71)])
construct_mesh = ConstructMesh(Vertices=deconstruct_mesh.Vertices, Faces=deconstruct_mesh.Faces, Colours=gradient)
m_catmull_clark = WeightedCatmullClarkSubdivision(M=construct_mesh, L=Slider(1, range=0..10), E=Slider(1, range=0..10), DF=0, TE=1, TV=1)  # -> out, A; inputs M: Mesh, DF: list, TE: list, TV: list; same code as m_catmull_clark
A = ClusterOutput(m_catmull_clark.A)

# ==== cluster Cluster_7
data = ClusterInput()
data_2 = Data(data)
text_split = TextSplit(Text=data_2, Separators=",")
B = ClusterInput()
list_item = ListItem(List=text_split, Index=0, Wrap=True)  # -> Item, Item1, Item2
multiplication = Multiplication(A=list_item.Item1, B=B)
merge = Merge(Data1=list_item.Item, Data2=multiplication, Data3=list_item.Item2)
text_join = TextJoin(Text=merge, Join=",")  # -> flatten(Result)
jitter = Jitter(List=text_join, Jitter=Slider(0.06, range=0..1), Seed=2)  # -> Values, Indices
data_3 = Data(jitter.Values)
data_4 = ClusterOutput(data_3)
