# Grasshopper definition spiral.gh (Grasshopper 1.0.7)

turns_count = GetNumber(Slider(9, range=0..100), AtLeast=1, AtMost=1, Maximum=1.797693135e+308, Minimum=-1.797693135e+308)
length = GetNumber(Slider(129, range=0..150), AtLeast=1, AtMost=1, Maximum=1.797693135e+308, Minimum=-1.797693135e+308)
profile = GetNumber(Slider(60, range=0..180), AtLeast=1, AtMost=1, Maximum=1.797693135e+308, Minimum=-1.797693135e+308)
series = Series(Start=0, Step=turns_count, Count=length)
series_2 = Series(Start=0, Step=1, Count=length)
series_3 = Series(Start=0, Step=turns_count, Count=length)
series_4 = Series(Start=0, Step=1, Count=length)
pt = PointPolar(BasePlane=PlaneXY(0, 0, 0), XYAngle=degrees(series), ZAngle=0, Offset=series_2)
pt_2 = PointPolar(BasePlane=PlaneXY(0, 0, 0), XYAngle=degrees(series_3), ZAngle=degrees(profile), Offset=series_4)
nurbs = NurbsCurve(Vertices=pt, Degree=3, Periodic=False)  # -> Curve, Length, Domain
nurbs_2 = NurbsCurve(Vertices=pt_2, Degree=3, Periodic=False)  # -> Curve, Length, Domain
loft = Loft(
    Curves=[nurbs.Curve, nurbs_2.Curve],
    Options={Adjust=False, Closed=False, LoftEnds=0, LoftSimp=0, LoftType=0, Rebuild=10, Refit=0.01})
mesh = Mesh(loft)
area = Area(Geometry=mesh, UseTasks=True)  # -> Area, Centroid

# ---- group: RH_OUT:mesh
mesh_2 = Mesh(loft)

# ---- group: RH_OUT:area
data = Data(area.Area)
